# Grasshopper definition hw02-wing-01.gh (Grasshopper 1.0.7)

# ----
# MAIN INPUTS
airfoil_cardboard_thinkness = Slider(0.073, range=0..0.25)
spar_one_thickness = Slider(0.453, range=0..2)
slot_one_depth = Slider(0.25, range=0..1)
airfoil_count = Slider(0, range=0..20)
wingspan = Slider(22.408, range=0..48)

# ----
# SPAR ONE
# Wingspan
# Spar Thickness
rectangle = Rectangle(Plane=PlaneXY(0, 0, 0), XSize=wingspan, YSize=spar_one_thickness, Radius=spar_one_thickness)  # -> Rectangle, Length

# ----
# SPAR ONE SLOT
# Slot Depth
# Airfoil Cardboard Thickness
rectangle_2 = Rectangle(Plane=PlaneXY(0, 0, 0), XSize=airfoil_cardboard_thinkness, YSize=slot_one_depth, Radius=0)  # -> Rectangle, Length

# ----
# END AIRFOIL PLACEMENT
# Left Airfoil
# Spar Slot
# Wingspan
# Right Airfoil
# Offset from spar end
# 2
# 2
wingspan_fraction = Slider(0.013, range=0..1)
multiplication = Multiplication(A=wingspan, B=wingspan_fraction)
num = Number(2)
X = UnitX(Factor=multiplication)
multiplication_2 = Multiplication(A=multiplication, B=num)
move = Move(Geometry=rectangle_2.Rectangle, Motion=X)  # -> Geometry, Transform
subtraction = Subtraction(A=wingspan, B=multiplication_2)
X_2 = UnitX(Factor=subtraction)
arrlinear = LinearArray(Geometry=move.Geometry, Direction=X_2, Count=num)  # -> Geometry, Transform

# ----
# CALCULATE AIRFOIL SPACING
# Wing Span
# Spar Count
relay = Relay()
relay_2 = Relay()
integer_division = IntegerDivision(A=relay, B=relay_2)

# ----
# REPLICATE SPAR SLOTS
# Spar Slot
# Spar Spacing
# Spar Count
relay_3 = Relay()
relay_4 = Relay()
X_3 = UnitX(Factor=relay_4)
arrlinear_2 = LinearArray(Geometry=rectangle_2.Rectangle, Direction=X_3, Count=relay_3)  # -> Geometry, Transform
